# Dynamo graph LINE DIFFERENCES.dyn (Dynamo 2.5.1.7586)
# packages: Civil3DToolkit 1.1.28

select_object = ObjectSelection()  # 1 picked in the model
getGeometry = Autodesk.AutoCAD.DynamoNodes.PolylineExtensions.GetGeometry(polyline=select_object)
select_object_2 = ObjectSelection()  # 1 picked in the model
getGeometry_2 = Autodesk.AutoCAD.DynamoNodes.PolylineExtensions.GetGeometry(polyline=select_object_2)

# group: Creating List of Curve Parameters
length = Curve.Length(curve=getGeometry_2)
watch = Watch(length)
delta_x = CodeBlock { 100; }
code_block = CodeBlock(a=watch, b=delta_x) { a/b; }
watch_2 = Watch(code_block)
round = Math.Round(number=watch_2)
code_block_2 = CodeBlock(a=round) { 1/a; }
code_block_3 = CodeBlock(a=code_block_2) { 0..1..a; }

# group: Creating Points and Planes at Curve Parameters
planeAtParameter = Curve.PlaneAtParameter(curve=getGeometry_2, param=code_block_3)
pointAtParameter = Curve.PointAtParameter(curve=getGeometry_2, param=code_block_3)

code_block_4 = CodeBlock { 0; }
removeItemAtIndex = List.RemoveItemAtIndex(list=planeAtParameter, indices=code_block_4)

# group: Intersections (Points) Of Second Curve with Planes
intersect = Geometry.Intersect(geometry=getGeometry, other=removeItemAtIndex)

flatten = List.Flatten(list=intersect)

# group: Points At Curve 1
code_block_5 = CodeBlock(a=flatten) { a; }

code_block_6 = CodeBlock { 0; }
removeItemAtIndex_2 = List.RemoveItemAtIndex(list=pointAtParameter, indices=code_block_6)

# group (continued): Creating Points and Planes at Curve Parameters
watch_3 = Watch(removeItemAtIndex_2)

# group: Points At Curve 2
code_block_7 = CodeBlock(a=watch_3) { a; }

# group: Creation of Projected Curves
byStartPointEndPoint = Line.ByStartPointEndPoint(startPoint=code_block_5, endPoint=code_block_7)
byOriginNormal = Plane.ByOriginNormal()
ZAxis = Vector.ZAxis()
project = Curve.Project(curve=byStartPointEndPoint, baseGeometry=byOriginNormal, projectionDirection=ZAxis)
flatten_2 = List.Flatten(list=project)

# group: Projected Curves Length
length_2 = Curve.Length(curve=flatten_2)

# group: Projected Curve Length Result
projected_flat_length = Watch(length_2)

# group: Delta Z Calculation
code_block_8 = CodeBlock(a=code_block_5) { a.Z; }
code_block_9 = CodeBlock(a=code_block_7) { a.Z; }
code_block_10 = CodeBlock(a=code_block_8, b=code_block_9) { dZ=a-b; }

# group: Delta Z Results
delta_z = Watch(code_block_10)

# group: Delta X Calculation
code_block_11 = CodeBlock(a=code_block_5) { a.X; }
code_block_12 = CodeBlock(a=code_block_7) { a.X; }
code_block_13 = CodeBlock(a=code_block_11, b=code_block_12) { dX=a-b; }

# group: Delta X Results
delta_z_2 = Watch(code_block_13)

# group: Delta Y Calculation
code_block_14 = CodeBlock(a=code_block_5) { a.Y; }
code_block_15 = CodeBlock(a=code_block_7) { a.Y; }
code_block_16 = CodeBlock(a=code_block_14, b=code_block_15) { dY=a-b; }

# group: Delta Y Results
delta_z_3 = Watch(code_block_16)

# group: CSV (Excel) File Export
file_path = Filename(".\CSV Export.csv")
list_create = List.Create(item0=delta_z, item1=delta_z_2, item2=delta_z_3)
transpose = List.Transpose(lists=list_create)
exportCSV = Data.ExportCSV(filePath=file_path, data=transpose)

code_block_17 = CodeBlock {  }
